# Grasshopper definition export_3D_isovist_pointcoud.gh (Grasshopper 1.0.7)

# ---- group: inputs
md_slider = MDSlider(
    SliderMode=0,
    slider_value=Point(0.626742959, 0.2639355659, 0.5),
    x_domain=Domain(0, 1),
    y_domain=Domain(0, 1),
    z_domain=Domain(0, 1))
button = Button()
panel = Panel("D:test")

# ---- group: inputs / point_num
panel_2 = Panel("100")

# ---- group: inputs / tgt_area
srf = Surface(reparameterize(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))

# ---- group: inputs / range
panel_3 = Panel("2500.0")

# ---- group: inputs / obstacles
brep = Brep([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])

# ----
evalsrf = EvaluateSurface(Surface=srf, Point=md_slider)  # -> Point, Normal, UDirection, VDirection, Frame

# ---- group: view_point
pt = Point(evalsrf.Point)

# ---- group: calculate 3D isovist
sph = Sphere(Base=pt, Radius=panel_3)
popgeo = PopulateGeometry(Geometry=sph, Count=panel_2, Seed=1)
ln = Line(StartPoint=pt, EndPoint=popgeo)
ivray = IsoVistRay(Sample=ln, Radius=panel_3, Obstacles=brep)  # -> Point, Distance, Index

# ---- group: create filename
pdecon = Deconstruct(Point=pt)  # -> XComponent, YComponent, ZComponent
expression = Expression(u=pdecon.XComponent, v=pdecon.YComponent, Expression="Format(\"pcd_{0}_{1}.ply\", int(u), int(v))")
panel_4 = Panel(expression)

# ---- group: Check if the view_point is in the target_area.
incurve = PointInCurve(Point=pt, Curve=srf)  # -> Relationship, Point
equals = Equality(FirstNumber=incurve.Relationship, SecondNumber="2")  # -> Equality, Inequality
panel_5 = Panel(equals.Equality)

# ----
panel_6 = Panel(ivray.Point)

# ----
# returns True if the view_point is in the target area and the button is True.
and = GateAnd(A=equals.Equality, B=button)

# ---- group: export pointcloud
exportpcd = GhPythonScript(output_dir=panel, filename=panel_4, points=ivray.Point, run=and)  # -> out; inputs points: list
# ---------- exportpcd: Python ----------
"""Provides a scripting component.
    Inputs:
        output_dir: output_dir, must be made before execution.
        filename: filename of the output pointcloud.
        points: list of points.
        run: if true, the pointcloud will be exported.
    Output:
        out: log messages.
        """

__author__ = "kado"
__version__ = "2022.07.02"

import rhinoscriptsyntax as rs
import os

def WriteHeader(f, elemNun):
    f.write("ply\n")
    f.write("format ascii 1.0\n")
    f.write("comment Created by ***\n")
    f.write("element vertex {}\n".format(elemNun))
    f.write("property double x\n")
    f.write("property double y\n")
    f.write("property double z\n")
    f.write("end_header\n")
    
def WriteRow(f, pnt):
    r = "{} {} {}".format(pnt.X, pnt.Y, pnt.Z)
    r += "\n"
    f.write(r)


assert os.path.exists(output_dir), "\"{}\" does not exist!".format(output_dir)

dest = os.path.join(output_dir, filename)

if run:
    points = rs.coerce3dpointlist(points)
    pointNum = len(points)

    with open(dest, mode='w') as f:
        WriteHeader(f, pointNum)
        for i in range(pointNum):
            p = points[i]
            WriteRow(f, p)
    
    print("save pointcloud as \"{}\"".format(dest))
    
print("input \"True\" to \"run\" to export a pointcloud")
# ---------- end exportpcd ----------
panel_7 = Panel(exportpcd)
